# Dynamo graph section2.dyn (Dynamo 3.4.1.7055)

byPoints = PolyCurve.ByPoints()  # unwired: points
type = Object.Type()  # unwired: object
file_path = Filename(".\section2.py")
readText = FileSystem.ReadText(file=file_path)
file_path_2 = Filename(".\pointRead.py")
readText_2 = FileSystem.ReadText(file=file_path_2)
csv_파일 = Filename("data\section 2 Civil Report.csv")
code_block = CodeBlock { 55; 164.75; }
차로폭_m = CodeBlock { 3.6; }
차로외부_폭_m = CodeBlock { 2.8; }
보강형_보_폭_m = CodeBlock { 1.2; }
인도폭_m = CodeBlock { 4.2; }
편도_차로수 = CodeBlock { 2; }
편경사 = CodeBlock { -2; }
python_script_from_string = PythonStringNode(script=readText, IN[0]=readText_2, IN[1]=csv_파일, IN[2]=code_block.out0, IN[3]=code_block.out1, IN[4]=차로폭_m, IN[5]=차로외부_폭_m, IN[6]=보강형_보_폭_m, IN[7]=인도폭_m, IN[8]=편도_차로수, IN[9]=편경사)  # CPython3
watch = Watch(python_script_from_string)
code_block_2 = CodeBlock(i=watch) { i[3]; }
